% Simulink data dictionary amcfoc.sldd
% references embeddedBoard_common.sldd

AmcfocInitConf = Simulink.Parameter([struct(
  thresholds=struct(
    jntVelMax=single(0),
    motorNominalCurrents=single(0),
    motorPeakCurrents=single(0),
    motorOverloadCurrents=single(0),
    motorPwmLimit=uint32(0),
    motorCriticalTemperature=single(0)),
  pids=struct(
    currentPID=struct(
      type=ControlModes.NotConfigured,
      OutMax=single(0),
      OutMin=single(0),
      P=single(0),
      I=single(0),
      D=single(0),
      N=single(0),
      I0=single(0),
      D0=single(0),
      shift_factor=uint8(0)),
    velocityPID=struct(
      type=ControlModes.NotConfigured,
      OutMax=single(0),
      OutMin=single(0),
      P=single(0),
      I=single(0),
      D=single(0),
      N=single(0),
      I0=single(0),
      D0=single(0),
      shift_factor=uint8(0)),
    positionPID=struct(
      type=ControlModes.NotConfigured,
      OutMax=single(0),
      OutMin=single(0),
      P=single(0),
      I=single(0),
      D=single(0),
      N=single(0),
      I0=single(0),
      D0=single(0),
      shift_factor=uint8(0))),
  motor=struct(
    externals=struct(
      enable_verbosity=false,
      has_hall_sens=false,
      has_quadrature_encoder=false,
      has_speed_quadrature_encoder=false,
      has_temperature_sens=false,
      encoder_tolerance=uint8(0),
      pole_pairs=uint8(0),
      rotor_encoder_resolution=int16(0),
      rotor_index_offset=int16(0),
      use_index=false),
    Kbemf=single(0),
    Rphase=single(0),
    Imin=single(0),
    Imax=single(0),
    Vmax=single(0),
    resistance=single(0),
    inductance=single(0),
    thermal_resistance=single(0),
    thermal_time_constant=single(0),
    hall_sensors_offset=single(0))), struct(
  thresholds=struct(
    jntVelMax=single(0),
    motorNominalCurrents=single(0),
    motorPeakCurrents=single(0),
    motorOverloadCurrents=single(0),
    motorPwmLimit=uint32(0),
    motorCriticalTemperature=single(0)),
  pids=struct(
    currentPID=struct(
      type=ControlModes.NotConfigured,
      OutMax=single(0),
      OutMin=single(0),
      P=single(0),
      I=single(0),
      D=single(0),
      N=single(0),
      I0=single(0),
      D0=single(0),
      shift_factor=uint8(0)),
    velocityPID=struct(
      type=ControlModes.NotConfigured,
      OutMax=single(0),
      OutMin=single(0),
      P=single(0),
      I=single(0),
      D=single(0),
      N=single(0),
      I0=single(0),
      D0=single(0),
      shift_factor=uint8(0)),
    positionPID=struct(
      type=ControlModes.NotConfigured,
      OutMax=single(0),
      OutMin=single(0),
      P=single(0),
      I=single(0),
      D=single(0),
      N=single(0),
      I0=single(0),
      D0=single(0),
      shift_factor=uint8(0))),
  motor=struct(
    externals=struct(
      enable_verbosity=false,
      has_hall_sens=false,
      has_quadrature_encoder=false,
      has_speed_quadrature_encoder=false,
      has_temperature_sens=false,
      encoder_tolerance=uint8(0),
      pole_pairs=uint8(0),
      rotor_encoder_resolution=int16(0),
      rotor_index_offset=int16(0),
      use_index=false),
    Kbemf=single(0),
    Rphase=single(0),
    Imin=single(0),
    Imax=single(0),
    Vmax=single(0),
    resistance=single(0),
    inductance=single(0),
    thermal_resistance=single(0),
    thermal_time_constant=single(0),
    hall_sensors_offset=single(0)))], StorageClass="ExportedGlobal", Alias="AmcfocInitConf", DataType="Bus: ActuatorConfiguration")

N_MOTORS = int32(2)